# Grasshopper definition cone_to_creal_yarn_model.gh (Grasshopper 1.0.8)

# ---- group: Height Control
number_slider = Slider(172, range=0..1000)
multiplication = Multiplication(A=number_slider, B=Slider(0.37, range=0..1))
subtraction = Subtraction(A=number_slider, B=multiplication)

# ---- group: Circle Setup
pt = Point(Point(0, 0, 0))
division = Division(A=Slider(100, range=0..200), B=2)
cir = Circle(Plane=pt, Radius=division)

# ---- group: Rim Point
eval = EvaluateCurve(Curve=reparameterize(cir), Parameter=Slider(0.25, range=0..1))  # -> Point, Tangent, Angle
neg = Negative(Value=eval.Tangent)
filter = StreamFilter(Gate=Toggle(True), Stream0=eval.Tangent, Stream1=neg)

# ---- group: Line Setup
Z = UnitZ(Factor=1)
Z_2 = UnitZ(Factor=subtraction)
move = Move(Geometry=pt, Motion=Z_2)  # -> Geometry, Transform
line = LineSDL(Start=move.Geometry, Direction=Z, Length=multiplication)

# ---- group: Connecting Curve
rad = Radians(Degrees=Slider(0, range=0..90))
vec2pt = Vector2Pt(PointA=move.Geometry, PointB=eval.Point, Unitize=False)  # -> Vector, Length
xprod = CrossProduct(VectorA=vec2pt.Vector, VectorB=Z, Unitize=False)  # -> Vector, Length
vrot = Rotate(Vector=Z, Axis=xprod.Vector, Angle=rad)
biarc = BiArc(StartPoint=eval.Point, StartTangent=filter, EndPoint=move.Geometry, EndTangent=vrot, Ratio=Slider(0.53, range=0..1))  # -> FirstArc, SecondArc, BiArc

# ---- group: Joined Result
join = JoinCurves(Curves=[biarc.BiArc, line], Preserve=False)

# ---- group: Output Selector
end = EndPoints(Curve=line)  # -> Start, End
ln = Line(StartPoint=eval.Point, EndPoint=end.End)
filter_2 = StreamFilter(Gate=Toggle(False), Stream0=ln, Stream1=join)
