# Grasshopper definition grass_hopper_to_make_point_pairs.gh (Grasshopper 1.0.8)

# ---- group: Inputs
pt = Point(Point(89, 70, 0))
pt_2 = Point(Point(21, 37, 0))
pt_3 = Point(Point(-10, 191, 0))
pt_4 = Point(Point(0, 163, 166))

# ---- group: Division Logic
number_slider = Slider(2, range=2..50)
ln = Line(StartPoint=pt, EndPoint=pt_2)
ln_2 = Line(StartPoint=pt_3, EndPoint=pt_4)
divide = DivideCurve(Curve=ln, Count=expr("x-1", number_slider), Kinks=False)  # -> Points, Tangents, Parameters
divide_2 = DivideCurve(Curve=ln_2, Count=expr("x-1", number_slider), Kinks=False)  # -> Points, Tangents, Parameters

# ---- group: Output
ln_3 = Line(StartPoint=divide.Points, EndPoint=divide_2.Points)
