# Grasshopper definition grasshopper_to_place_cone_adaptive_end_effector.gh (Grasshopper 1.0.8)

number_slider = Slider(44.6, range=0..1000)
brep = Brep(<brep referenced from the Rhino model>)
pt = Point(Point(0, 0, 0))
number_slider_2 = Slider(150, range=0..5000)
number_slider_3 = Slider(406.4, range=0..1000)
number_slider_4 = Slider(7, range=1..50)
number_slider_5 = Slider(339.6, range=0..1000)
number_slider_6 = Slider(2679.7, range=0..5000)
pt_2 = Point(Point(2409.247621, 1159.851361, 1369.105749))
bbox = BoundingBox(Content=brep, Plane=PlaneXY(0, 0, 0))  # -> Box, Box_2
pt_3 = Point(Point(2409.247621, 943.7312349, 2083.044141))
number_slider_7 = Slider(1, range=1..50)
debox = DeconstructBox(Box=bbox.Box)  # -> Plane, X, Y, Z
division = Division(A=number_slider_5, B="2")
pt_4 = Point(Point(3279.61159, 943.7312349, 2.058135835))
dedomain = DeconstructDomain(Domain=debox.X)  # -> Start, End
pt_5 = Point(Point(0, 0, 0))
number_slider_8 = Slider(600, range=0..5000)
number_slider_9 = Slider(400, range=0..1000)
division_2 = Division(A=number_slider_9, B="-2")
division_3 = Division(A=number_slider_8, B="2")
subtraction = Subtraction(A=dedomain.End, B=dedomain.Start)
addition = Addition(A=division_3, B="1200")
pt_6 = ConstructPoint(XCoordinate=addition, YCoordinate=division_2, ZCoordinate="500")
vec = VectorXYZ(
    XComponent=Slider(1000, range=-8000..2000),
    YComponent=Slider(-260, range=-2000..2000),
    ZComponent=Slider(400, range=-2000..2000))  # -> Vector, Length
number_slider_10 = Slider(8, range=0..100)
cluster = Cluster(
    relay_2=number_slider_3,
    Y=number_slider_6,
    N=number_slider_5,
    C=number_slider_4,
    relay_3=number_slider_2,
    B_2=division,
    G=brep,
    A=pt,
    relay=number_slider,
    B=pt_3)  # -> L, out_cone_centroid_bottoms, out_cones, out_rectangle
pt_7 = Point(Point(2658.44867, 975.3163464, 1555.577932))
pt_8 = Point(pt_6)
vec_2 = VectorXYZ(XComponent="0", YComponent=Slider(476.951, range=-2000..2000), ZComponent="0")  # -> Vector, Length
cluster_2 = Cluster(
    relay_2=number_slider_3,
    Y=number_slider_6,
    N=number_slider_5,
    C=number_slider_4,
    relay_3=number_slider_2,
    B_2=division,
    G=brep,
    A=pt,
    relay=number_slider,
    B=pt_2)  # -> L, out_cone_centroid_bottoms, out_cones, out_rectangle
merge = Merge(
    Data1=number_slider_3,
    Data2=number_slider_4,
    Data3=number_slider_6,
    Data4=number_slider_6,
    Data5=number_slider_2,
    Data6=number_slider,
    Data7=number_slider_7)
cluster_3 = Cluster(
    relay_2=number_slider_3,
    Y=number_slider_6,
    N=number_slider_5,
    C=number_slider_7,
    relay_3=number_slider_2,
    B_2=division,
    G=brep,
    A=pt,
    relay=number_slider,
    B=pt_4)  # -> L, out_cone_centroid_bottoms, out_cones, out_rectangle
yarn_radius = Slider(2, range=0..5)
pt_9 = Point(Point(2880.910316, 975.3163464, 1555.577932))
pt_10 = Point(Point(2934.405819, 1218.210956, 2033.903443))
pt_11 = Point(Point(2934.405819, 2258.685291, 2033.903443))
pt_12 = Point(Point(2934.405819, 1218.210956, 2033.903443))
mesh = Mesh(<mesh referenced from the Rhino model>)
pt_13 = Point(Point(3091.937875, 1223.763175, 2033.903443))
cluster_4 = Cluster_3(C=brep)
division_4 = Division(A=subtraction, B="2")
subtraction_2 = Subtraction(A=cluster_4, B="7")
cluster_5 = Cluster_3(C=mesh)
pt_14 = Point(Point(2934.405819, 3753.066381, 2033.903443))
brep_2 = Brep(<brep referenced from the Rhino model>)
pt_15 = Point(Point(3076.70422, 3737.626507, 2033.903443))
pt_16 = Point(Point(2658.44867, 3929.71677, 1555.577932))
pt_17 = Point(Point(2880.910316, 3951.765053, 1555.577932))
pt_18 = Point(Point(2934.405819, 3753.066381, 2033.903443))
addition_2 = Addition(A="42", B="1")
pt_19 = Point(Point(2934.405819, 2708.838534, 2033.903443))
vec_3 = VectorXYZ(XComponent="0", YComponent="0", ZComponent=subtraction_2)  # -> Vector, Length
pt_20 = Point(Point(0, 119, 834.0691612))
cluster_6 = Cluster(
    relay_2=number_slider_9,
    Y=number_slider_8,
    N=subtraction,
    C=Slider(3, range=1..50),
    relay_3=division_4,
    B_2="0",
    G=brep,
    A=pt_5,
    relay=division_4,
    B=pt_8)  # -> L, out_cone_centroid_bottoms, out_cones, out_rectangle
addition_3 = Addition(A=addition_2, B="1")
py3 = Python3Script(name="celling", trigger=Button(), geometry=brep_2, color=ColourSwatch(SwatchColor=RGB(215, 211, 35)))  # -> out, a
# ---------- py3: Python ----------
import Rhino.Geometry as rg
import scriptcontext as sc
import System
import struct
import os
import sys

# ---------------------------------------------------------------------------
# Inputs:
#   geometry   : any geometry (mesh, brep, guid) — flat list or tree
#   name       : string — name for the object in RoboDK
#   color      : colour — optional, defaults to grey
#   trigger    : boolean — set True to push
# ---------------------------------------------------------------------------

if trigger:
    sc.sticky[f"last_{name}_done"] = False
    print(f"Trigger activated for '{name}'")

if not trigger and sc.sticky.get(f"last_{name}_done", False):
    print("No trigger — skipping")
else:
    # -----------------------------------------------------------------------
    # Flatten any input type into a list of geometry items
    # -----------------------------------------------------------------------
    def flatten(gh_input):
        result = []
        if hasattr(gh_input, 'Branches'):
            for branch in gh_input.Branches:
                for item in branch:
                    if item is not None:
                        result.append(item)
        elif hasattr(gh_input, '__iter__') and not isinstance(gh_input, (rg.Mesh, rg.Point3d)):
            for item in gh_input:
                if item is not None:
                    result.append(item)
        elif gh_input is not None:
            result.append(gh_input)
        return result

    geo_list = flatten(geometry)
    print(f"'{name}': {len(geo_list)} items")

    # -----------------------------------------------------------------------
    # Build combined mesh
    # -----------------------------------------------------------------------
    mesh_list = rg.Mesh()
    for geo in geo_list:
        if isinstance(geo, rg.Mesh):
            geo.Faces.ConvertQuadsToTriangles()
            mesh_list.Append(geo)
        elif isinstance(geo, rg.Brep):
            meshes = rg.Mesh.CreateFromBrep(geo, rg.MeshingParameters.Coarse)
            if meshes:
                for m in meshes:
                    m.Faces.ConvertQuadsToTriangles()
                    mesh_list.Append(m)
        elif isinstance(geo, System.Guid):
            obj = sc.doc.Objects.FindId(geo)
            if obj:
                g = obj.Geometry
                if isinstance(g, rg.Mesh):
                    g.Faces.ConvertQuadsToTriangles()
                    mesh_list.Append(g)
                elif isinstance(g, rg.Brep):
                    meshes = rg.Mesh.CreateFromBrep(g, rg.MeshingParameters.Coarse)
                    if meshes:
                        for m in meshes:
                            m.Faces.ConvertQuadsToTriangles()
                            mesh_list.Append(m)

    mesh_list.Faces.ConvertQuadsToTriangles()
    triangles = []
    for i in range(mesh_list.Faces.Count):
        face = mesh_list.Faces[i]
        triangles.append((
            mesh_list.Vertices[face.A],
            mesh_list.Vertices[face.B],
            mesh_list.Vertices[face.C]
        ))
    print(f"  {len(triangles)} triangles")

    # -----------------------------------------------------------------------
    # Write STL
    # -----------------------------------------------------------------------
    safe_name = name.replace(" ", "_")
    stl_path = f"C:/temp/{safe_name}.stl"
    os.makedirs("C:/temp", exist_ok=True)
    with open(stl_path, 'wb') as f:
        f.write(b'\0' * 80)
        f.write(struct.pack('<I', len(triangles)))
        for v0, v1, v2 in triangles:
            f.write(struct.pack('<fff', 0, 0, 0))
            f.write(struct.pack('<fff', v0.X, v0.Y, v0.Z))
            f.write(struct.pack('<fff', v1.X, v1.Y, v1.Z))
            f.write(struct.pack('<fff', v2.X, v2.Y, v2.Z))
            f.write(struct.pack('<H', 0))
    print(f"  STL -> {stl_path}")

    # -----------------------------------------------------------------------
    # Resolve colour input to [R, G, B, A] 0-1
    # -----------------------------------------------------------------------
    def resolve_color(c, default):
        if c is None:
            return default
        raw = c
        if hasattr(c, 'Branches'):
            try: raw = list(c.Branches[0])[0]
            except: return default
        if type(raw).__name__ == 'Color' or (hasattr(raw, 'R') and hasattr(raw, 'G') and hasattr(raw, 'B')):
            return [raw.R/255.0, raw.G/255.0, raw.B/255.0, raw.A/255.0 if hasattr(raw,'A') else 1.0]
        return default

    rgba = resolve_color(color, [0.6, 0.6, 0.65, 1.0])

    # -----------------------------------------------------------------------
    # Push to RoboDK
    # -----------------------------------------------------------------------
    try:
        sys.path.append("C:/RoboDK/Python")
        from robodk.robolink import Robolink

        RDK = Robolink()
        station = RDK.Item("", 1)
        print(f"  Station: {station.Name()}")

        # Purge any existing item with this name
        for _ in range(50):
            old = RDK.Item(safe_name)
            if not old.Valid(): break
            old.Delete()
            print(f"  purged old '{safe_name}'")

        # Load via snapshot
        before = set(it.item for it in RDK.ItemList(6, False))
        RDK.AddFile(stl_path)
        new_item = None
        for it in RDK.ItemList(6, False):
            if it.item not in before:
                new_item = it
                break
        if new_item is None:
            new_item = RDK.Item(safe_name)

        if new_item.Valid():
            new_item.setColor(rgba)
            print(f"  '{new_item.Name()}' loaded, color={[round(v,2) for v in rgba]}")
        else:
            print(f"  WARNING: item not valid after load")

        sc.sticky[f"last_{name}_done"] = True

    except Exception as e:
        print(f"RoboDK error: {e}")
        import traceback
        traceback.print_exc()
# ---------- end py3 ----------
pt_21 = Point(Point(0, 0, 334))
cluster_7 = Cluster_5(
    Z=Slider(253.489, range=0..2000),
    B=Slider(646.111, range=0..2000),
    relay_2=Slider(166.496, range=0..2000),
    relay=Slider(122.219, range=0..2000),
    B_2=Slider(3, range=0..2000))  # -> R, B_3, P
vec_4 = VectorXYZ(XComponent="0", YComponent="0", ZComponent=cluster_5)  # -> Vector, Length
pdecon = Deconstruct(Point=pt_8)  # -> XComponent, YComponent, ZComponent
pt_22 = Point(Point(0, 0, 0))
subtraction_3 = Subtraction(A=pdecon.YComponent, B=division_2)
subtraction_4 = Subtraction(A=pdecon.XComponent, B=division_3)
move = Move(Geometry=cluster_2.out_cone_centroid_bottoms, Motion=vec_3.Vector)  # -> Geometry, Transform
random = Random(Range=Domain(0, 1), Number=cluster_2.L, Seed=addition_3)
cluster_8 = Cluster_4(start_line_1=pt_7, B=pt_9, A=pt_10, B_2=pt_11, N=number_slider_10)
random_2 = Random(Range=Domain(0, 1), Number=cluster_2.L, Seed=addition_2)
cluster_9 = Cluster_4(start_line_1=pt_12, B=pt_13, A=pt_10, B_2=pt_11, N=number_slider_10)
py3_2 = Python3Script(seed="42", count=cluster_2.L)  # -> flatten(a)
# ---------- py3_2: Python ----------
import random

# Inputs: count (integer), seed (integer)

random.seed(seed)
a = [random.choice([True, False]) for _ in range(count)]
# ---------- end py3_2 ----------
cluster_10 = Cluster_4(start_line_1=pt_16, B=pt_17, A=pt_18, B_2=pt_19, N=number_slider_10)
cluster_11 = Cluster_4(start_line_1=pt_7, B=pt_9, A=pt_12, B_2=pt_13, N=number_slider_10)
panel = Panel(cluster_2.L)
panel_2 = Panel(cluster.L)
pt_23 = ConstructPoint(XCoordinate=subtraction_4, YCoordinate=subtraction_3, ZCoordinate=pdecon.ZComponent)
panel_3 = Panel(cluster_3.L)
move_2 = Move(Geometry=cluster_7.R, Motion=vec_4.Vector)  # -> Geometry, Transform
cluster_12 = Cluster_4(start_line_1=pt_14, B=pt_15, A=pt_18, B_2=pt_19, N=number_slider_10)
cluster_13 = Cluster_4(start_line_1=pt_16, B=pt_17, A=pt_14, B_2=pt_15, N=number_slider_10)
move_3 = Move(Geometry=cluster_7.B_3, Motion=vec_4.Vector)  # -> Geometry, Transform
move_4 = Move(Geometry=cluster_7.P, Motion=vec_4.Vector)  # -> Geometry, Transform
vec_5 = VectorXYZ(XComponent="0", YComponent="0", ZComponent="1")  # -> Vector, Length
vec_6 = VectorXYZ(XComponent="0", YComponent="0", ZComponent="-1")  # -> Vector, Length
vec_7 = VectorXYZ(XComponent="0", YComponent="0", ZComponent="1")  # -> Vector, Length
panel_4 = Panel(cluster_3.out_cones)
rotate = Rotate(Geometry=cluster_6.out_cone_centroid_bottoms, Angle="pi/2", Plane=pt_8)  # -> Geometry, Transform
rotate_2 = Rotate(Geometry=cluster_6.out_cones, Angle="pi/2", Plane=pt_8)  # -> Geometry, Transform
rotate_3 = Rotate(Geometry=cluster_6.out_rectangle, Angle="pi/2", Plane=pt_8)  # -> Geometry, Transform
pl = PlaneNormal(Origin=pt_20, ZAxis=vec_7.Vector)
pl_2 = PlaneNormal(Origin=pt_21, ZAxis=vec_6.Vector)
merge_2 = Merge(Data1=cluster_11, Data2=cluster_9)
pl_3 = PlaneNormal(Origin=pt_22, ZAxis=vec_5.Vector)
addition_4 = Addition(A=cluster_2.L, B=cluster.L, C=cluster_3.L)
merge_3 = Merge(Data1=cluster_13, Data2=cluster_12)
merge_4 = Merge(Data1=move_2.Geometry, Data2=mesh)
merge_5 = Merge(Data1=cluster_8, Data2=cluster_10)  # -> flatten(Result)
rotate_4 = Rotate(Geometry=pl_2, Angle="pi/4", Plane=pl_2)  # -> Geometry, Transform
vec_8 = VectorXYZ(XComponent="0", YComponent="1", ZComponent="0")  # -> Vector, Length
multiplication = Multiplication(A=Slider(-15, range=-180..180), B="pi/180")
merge_6 = Merge(Data1=merge_2, Data2=merge_3)
pl_4 = PlaneNormal(Origin=pt_23, ZAxis=vec_8.Vector)
panel_5 = Panel(addition_4)
rotate_5 = Rotate(Geometry=rotate_2.Geometry, Angle=multiplication, Plane=pl_4)  # -> Geometry, Transform
py3_3 = Python3Script(
    static_geometry=flatten(merge_4),
    moving_geometry=move_3.Geometry,
    joint_axis_plane=move_4.Geometry,
    trigger=Toggle(True),
    joint_open_angle="0",
    joint_closed_angle="90",
    import_angle="0",
    pickup_plane=rotate_4.Geometry,
    knotting_plane=pl,
    flange_plane=pl_3,
    pickup_on_moving=Toggle(True),
    knotting_on_moving=Toggle(True))  # -> out, a; inputs static_geometry: tree
# ---------- py3_3: Python ----------
from Grasshopper import DataTree
import Rhino
import Rhino.Geometry as rg
import scriptcontext as sc
import System
import struct
import os
import sys

# ---------------------------------------------------------------------------
# GH inputs:
#   static_geometry       : breps/meshes for the static part of the EE
#   moving_geometry       : breps/meshes for the moving part of the EE
#   flange_plane          : plane at robot flange (tool0) origin
#   joint_axis_plane      : plane whose Z axis is the rotation axis of the
#                           moving part, origin at the pivot point
#   joint_open_angle      : float (degrees) — open position of moving part
#   joint_closed_angle    : float (degrees) — closed position of moving part
#   pickup_plane          : plane at pickup TCP
#   pickup_on_moving      : bool — True if pickup_plane is on the moving part
#   knotting_plane        : plane at knotting TCP
#   knotting_on_moving    : bool — True if knotting_plane is on the moving part
#   trigger               : bool
# ---------------------------------------------------------------------------

if trigger:
    sc.sticky["last_ee_stl_path"] = ""
    print("Trigger activated, forcing re-run")

# ---------------------------------------------------------------------------
# Helpers
# ---------------------------------------------------------------------------
def flatten_input(gh_input, exclude_type=None):
    result = []
    if hasattr(gh_input, 'Branches'):
        for branch in gh_input.Branches:
            for item in branch:
                if item is not None:
                    result.append(item)
    elif hasattr(gh_input, '__iter__') and (exclude_type is None or not isinstance(gh_input, exclude_type)):
        for item in gh_input:
            if item is not None:
                result.append(item)
    elif gh_input is not None:
        result.append(gh_input)
    return result

def resolve_plane(item):
    if item is None:
        return None
    if isinstance(item, rg.Plane):
        return item
    if isinstance(item, System.Guid):
        rhino_obj = sc.doc.Objects.FindId(item)
        if rhino_obj:
            geo = rhino_obj.Geometry
            if isinstance(geo, rg.Plane):
                return geo
            if hasattr(geo, 'FrameAt'):
                ok, frame = geo.FrameAt(0, 0)
                if ok:
                    return frame
            centre = geo.GetBoundingBox(True).Center
            return rg.Plane(centre, rg.Vector3d.ZAxis)
        print(f"  Could not find Guid: {item}")
        return None
    if isinstance(item, rg.Point3d):
        return rg.Plane(item, rg.Vector3d.ZAxis)
    if isinstance(item, rg.Point):
        return rg.Plane(item.Location, rg.Vector3d.ZAxis)
    if hasattr(item, 'X') and hasattr(item, 'Y') and hasattr(item, 'Z'):
        return rg.Plane(rg.Point3d(item.X, item.Y, item.Z), rg.Vector3d.ZAxis)
    print(f"  Unknown plane type: {type(item)}")
    return None

def resolve_first_plane(gh_input):
    items = flatten_input(gh_input, exclude_type=rg.Plane)
    if not items:
        return resolve_plane(gh_input)
    for item in items:
        pl = resolve_plane(item)
        if pl is not None:
            return pl
    return None

def resolve_bool(gh_input):
    """Resolve a GH boolean input. Returns None if not connected."""
    if gh_input is None:
        return None
    items = flatten_input(gh_input)
    if items:
        return bool(items[0])
    return None

def resolve_float(gh_input):
    """Resolve a GH float/number input. Returns None if not connected."""
    if gh_input is None:
        return None
    # Handle plain string or number directly (e.g. from a GH Panel)
    if isinstance(gh_input, (int, float)):
        return float(gh_input)
    if isinstance(gh_input, str):
        try:
            return float(gh_input.strip())
        except ValueError:
            return None
    items = flatten_input(gh_input)
    if items:
        val = items[0]
        # If the first item is itself a string (from a Panel), use it whole
        if isinstance(val, str):
            try:
                return float(val.strip())
            except ValueError:
                return None
        try:
            return float(val)
        except (TypeError, ValueError):
            return None
    return None

def plane_to_robodk_mat(plane, scale=1.0):
    from robodk.robomath import Mat
    x = plane.XAxis
    y = plane.YAxis
    z = plane.Normal
    o = plane.Origin
    return Mat([
        [x.X, y.X, z.X, o.X * scale],
        [x.Y, y.Y, z.Y, o.Y * scale],
        [x.Z, y.Z, z.Z, o.Z * scale],
        [0,   0,   0,   1           ],
    ])

def tool_offset_mat(flange_plane, tool_plane, scale=1.0):
    from robodk.robomath import invH
    flange_mat = plane_to_robodk_mat(flange_plane, scale)
    tool_mat   = plane_to_robodk_mat(tool_plane,   scale)
    return invH(flange_mat) * tool_mat

def build_mesh_from_geo_list(geo_list):
    """Convert a list of breps/meshes/guids into a single rg.Mesh."""
    mesh_list = rg.Mesh()
    for geo in geo_list:
        if isinstance(geo, rg.Mesh):
            geo.Faces.ConvertQuadsToTriangles()
            mesh_list.Append(geo)
        elif isinstance(geo, rg.Brep):
            meshes = rg.Mesh.CreateFromBrep(geo, rg.MeshingParameters.Coarse)
            if meshes:
                for m in meshes:
                    m.Faces.ConvertQuadsToTriangles()
                    mesh_list.Append(m)
        elif isinstance(geo, System.Guid):
            rhino_obj = sc.doc.Objects.FindId(geo)
            if rhino_obj:
                obj_geo = rhino_obj.Geometry
                if isinstance(obj_geo, rg.Mesh):
                    obj_geo.Faces.ConvertQuadsToTriangles()
                    mesh_list.Append(obj_geo)
                elif isinstance(obj_geo, rg.Brep):
                    meshes = rg.Mesh.CreateFromBrep(obj_geo, rg.MeshingParameters.Coarse)
                    if meshes:
                        for m in meshes:
                            m.Faces.ConvertQuadsToTriangles()
                            mesh_list.Append(m)
    mesh_list.Faces.ConvertQuadsToTriangles()
    return mesh_list

def write_stl(mesh, stl_path):
    """Write a single rg.Mesh to a binary STL file."""
    triangles = []
    for i in range(mesh.Faces.Count):
        face = mesh.Faces[i]
        triangles.append((
            mesh.Vertices[face.A],
            mesh.Vertices[face.B],
            mesh.Vertices[face.C]
        ))
    os.makedirs(os.path.dirname(stl_path), exist_ok=True)
    with open(stl_path, 'wb') as f:
        f.write(b'\0' * 80)
        f.write(struct.pack('<I', len(triangles)))
        for v0, v1, v2 in triangles:
            f.write(struct.pack('<fff', 0, 0, 0))
            f.write(struct.pack('<fff', v0.X, v0.Y, v0.Z))
            f.write(struct.pack('<fff', v1.X, v1.Y, v1.Z))
            f.write(struct.pack('<fff', v2.X, v2.Y, v2.Z))
            f.write(struct.pack('<H', 0))
    return len(triangles)

# ---------------------------------------------------------------------------
# Collect inputs
# ---------------------------------------------------------------------------
static_geo_list  = flatten_input(static_geometry)   if 'static_geometry'  in dir() else []
moving_geo_list  = flatten_input(moving_geometry)   if 'moving_geometry'  in dir() else []
resolved_flange  = resolve_first_plane(flange_plane)     if 'flange_plane'     in dir() else None
resolved_axis    = resolve_first_plane(joint_axis_plane) if 'joint_axis_plane' in dir() else None
resolved_pickup  = resolve_first_plane(pickup_plane)     if 'pickup_plane'     in dir() else None
resolved_knot    = resolve_first_plane(knotting_plane)   if 'knotting_plane'   in dir() else None
pickup_moving    = resolve_bool(pickup_on_moving   if 'pickup_on_moving'   in dir() else None)
knotting_moving  = resolve_bool(knotting_on_moving if 'knotting_on_moving' in dir() else None)
open_angle       = resolve_float(joint_open_angle   if 'joint_open_angle'   in dir() else None)
closed_angle     = resolve_float(joint_closed_angle if 'joint_closed_angle' in dir() else None)
import_angle     = resolve_float(import_angle       if 'import_angle'       in dir() else None)

print(f"Static geo items  : {len(static_geo_list)}")
print(f"Moving geo items  : {len(moving_geo_list)}")
print(f"flange_plane      : {resolved_flange}")
print(f"joint_axis_plane  : {resolved_axis}")
print(f"open_angle        : {open_angle} deg")
print(f"closed_angle      : {closed_angle} deg")
print(f"import_angle      : {import_angle} deg")
print(f"pickup_plane      : {resolved_pickup}  (on_moving={pickup_moving})")
print(f"knotting_plane    : {resolved_knot}  (on_moving={knotting_moving})")

# ---------------------------------------------------------------------------
# Validate all required inputs — raise individually so GH shows each clearly
# ---------------------------------------------------------------------------
if not static_geo_list:
    raise ValueError("MISSING INPUT: static_geometry — connect the static EE brep/mesh")
if not moving_geo_list:
    raise ValueError("MISSING INPUT: moving_geometry — connect the moving part brep/mesh")
if resolved_flange is None:
    raise ValueError("MISSING INPUT: flange_plane — connect a plane at the robot flange origin")
if resolved_axis is None:
    raise ValueError("MISSING INPUT: joint_axis_plane — connect a plane at the pivot point (Z = rotation axis)")
if resolved_pickup is None:
    raise ValueError("MISSING INPUT: pickup_plane — connect the pickup TCP plane")
if resolved_knot is None:
    raise ValueError("MISSING INPUT: knotting_plane — connect the knotting TCP plane")
if open_angle is None:
    raise ValueError("MISSING INPUT: joint_open_angle — connect the open position angle (degrees)")
if closed_angle is None:
    raise ValueError("MISSING INPUT: joint_closed_angle — connect the closed position angle (degrees)")
if import_angle is None:
    raise ValueError("MISSING INPUT: import_angle — connect the starting angle for display in RoboDK (degrees)")
if pickup_moving is None:
    raise ValueError("MISSING INPUT: pickup_on_moving — connect a True/False toggle (is pickup_plane on the moving part?)")
if knotting_moving is None:
    raise ValueError("MISSING INPUT: knotting_on_moving — connect a True/False toggle (is knotting_plane on the moving part?)")

# ---------------------------------------------------------------------------
# Gate
# ---------------------------------------------------------------------------
if not trigger and sc.sticky.get("last_ee_stl_path", "") != "":
    a = sc.sticky.get("last_ee_stl_path", "")
    print("Trigger not set — skipping.")
else:
    print("Rebuilding...")

    # -----------------------------------------------------------------------
    # Export STLs
    # -----------------------------------------------------------------------
    static_stl_path = "C:/temp/end_effector_static.stl"
    moving_stl_path = "C:/temp/end_effector_moving.stl"

    static_tris = 0
    moving_tris = 0

    if static_geo_list:
        static_mesh = build_mesh_from_geo_list(static_geo_list)
        static_tris = write_stl(static_mesh, static_stl_path)
        print(f"Static STL: {static_tris} triangles -> {static_stl_path}")
    else:
        print("WARNING: no static geometry provided")

    if moving_geo_list:
        moving_mesh = build_mesh_from_geo_list(moving_geo_list)
        moving_tris = write_stl(moving_mesh, moving_stl_path)
        print(f"Moving STL: {moving_tris} triangles -> {moving_stl_path}")
    else:
        print("WARNING: no moving geometry provided — joint will have no visual geometry")

    # -----------------------------------------------------------------------
    # RoboDK
    # -----------------------------------------------------------------------
    try:
        sys.path.append("C:/RoboDK/Python")
        from robodk.robolink import Robolink
        from robodk.robomath import Mat, transl, invH, rotz, pi

        def identity():
            return Mat([[1,0,0,0],[0,1,0,0],[0,0,1,0],[0,0,0,1]])

        RDK = Robolink()
        station = RDK.Item("", 1)
        print(f"Station: {station.Name()}")

        def purge_all(name):
            count = 0
            for _ in range(50):
                item = RDK.Item(name)
                if not item.Valid():
                    break
                item.Delete()
                count += 1
            if count:
                print(f"  purged {count}x '{name}'")

        def add_file_and_get_item(path):
            before = set(it.item for it in RDK.ItemList(6, False))
            RDK.AddFile(path)
            for it in RDK.ItemList(6, False):
                if it.item not in before:
                    print(f"  -> loaded '{it.Name()}' id={it.item}")
                    return it
            stem = os.path.splitext(os.path.basename(path))[0]
            fb = RDK.Item(stem)
            print(f"  -> fallback '{stem}' valid={fb.Valid()}")
            return fb

        # Purge old items
        for name in ["end_effector_static", "end_effector_moving", "end_effector",
                     "EndEffector", "MovingPart", "pickup_point", "knotting_point"]:
            purge_all(name)

        # Find robot
        robot = RDK.Item("Fanuc R2000iC 125L")
        if not robot.Valid():
            robot = RDK.Item("", 4)
        if not robot.Valid():
            robot = RDK.Item("", 2)
        print(f"Robot: {robot.Name()}")

        ee_parent = robot if robot.Valid() else station

        fo = resolved_flange if resolved_flange is not None else rg.Plane(
            rg.Point3d(0, 0, 0), rg.Vector3d.ZAxis
        )

        # ── Static EE frame and geometry ────────────────────────────────────
        ee_frame = RDK.AddFrame("EndEffector", ee_parent)
        ee_frame.setPose(identity())

        if static_geo_list:
            static_obj = add_file_and_get_item(static_stl_path)
            if static_obj.Valid():
                static_obj.setColor([0.6, 0.6, 0.65, 1.0])  # same color as moving part
                static_obj.setParent(ee_frame)
                print("Static EE geometry: ok")
            else:
                print("WARNING: static STL not valid")

        # ── Moving part frame ────────────────────────────────────────────────
        # The moving part frame is parented to ee_frame.
        # Its local pose = the joint axis plane expressed relative to the flange.
        # RoboDK animates it by rotating around the frame's Z axis by joint angle.
        moving_frame = None
        if resolved_axis is not None:
            # Axis pose in flange frame
            axis_offset = tool_offset_mat(fo, resolved_axis)
            moving_frame = RDK.AddFrame("MovingPart", ee_frame)
            moving_frame.setPose(axis_offset)
            print(f"MovingPart frame: axis offset = ({axis_offset[0,3]:.2f}, {axis_offset[1,3]:.2f}, {axis_offset[2,3]:.2f}) mm")

            if moving_geo_list:
                moving_obj = add_file_and_get_item(moving_stl_path)
                if moving_obj.Valid():
                    moving_obj.setColor([0.6, 0.6, 0.65, 1.0])  # same color as static part
                    moving_obj.setParent(moving_frame)
                    # The STL is exported in Rhino world coordinates.
                    # We need to express that geometry relative to the MovingPart
                    # frame (the joint axis) so it sits in the right place.
                    # geometry_in_moving_frame = inv(axis_offset_in_flange) * inv(flange_in_world) * geometry_world
                    # Since the STL is at world origin in Rhino (EE modelled near origin),
                    # geometry_world = identity, so:
                    # geometry_in_moving_frame = inv(axis_offset)
                    # i.e. the geometry pose relative to the joint frame is the
                    # inverse of the joint frame pose relative to the flange.
                    moving_obj.setPose(invH(axis_offset))
                    print("Moving EE geometry: ok")
                else:
                    print("WARNING: moving STL not valid")

            # Set initial display pose to import_angle — rotate around Z
            # while keeping the axis_offset position intact.
            # axis_offset already positions the frame at the pivot point.
            # We post-multiply by rotz to apply the initial rotation in the
            # joint frame's own Z axis without moving the origin.
            from robodk.robomath import rotz
            import_rad = import_angle * pi / 180.0
            moving_frame.setPose(axis_offset * rotz(import_rad))
            print(f"MovingPart initial pose set to import_angle={import_angle} deg")

            # Store all angles in the frame name as a parseable string
            # setParam does not persist in RoboDK — encoding in name is reliable
            angle_name = "MovingPart|open=" + str(open_angle) + "|closed=" + str(closed_angle) + "|import=" + str(import_angle)
            moving_frame.setName(angle_name)
            print("Joint angles encoded in name: " + angle_name)
        else:
            print("WARNING: no joint_axis_plane — moving part frame not created")

        # ── Flange fallback
        fo_xyz = fo.Origin
        print(f"Flange origin: ({fo_xyz.X:.1f}, {fo_xyz.Y:.1f}, {fo_xyz.Z:.1f})")

        # ── Helper: compute TCP offset accounting for moving part ────────────
        def compute_tcp_offset(tcp_plane, on_moving):
            """
            Compute TCP offset in flange frame.
            If on_moving=True, the TCP plane is defined relative to the moving
            part at its OPEN position — we need to express it relative to the
            flange by going through the joint axis transform.
            If on_moving=False, it's directly on the static EE — same as before.
            """
            if not on_moving or resolved_axis is None:
                # Static — direct offset from flange
                return tool_offset_mat(fo, tcp_plane)
            else:
                # On moving part — offset is:
                #   flange -> axis_frame -> (open_angle rotation) -> tcp_in_moving_frame
                # We express it in flange frame so RoboDK's tool system handles it.
                # At open angle the moving frame pose = axis_offset * rotz(open_rad)
                # tcp_offset = axis_offset * rotz(open_rad) * tool_offset_in_moving
                from robodk.robomath import rotz
                open_rad        = open_angle * pi / 180.0
                axis_offset_mat = tool_offset_mat(fo, resolved_axis)
                tcp_in_moving   = tool_offset_mat(resolved_axis, tcp_plane)
                # Full offset: flange -> axis (at open) -> tcp
                return axis_offset_mat * rotz(open_rad) * tcp_in_moving

        # ── Create tools ─────────────────────────────────────────────────────
        def create_tool(name, tool_plane, flange_plane, on_moving):
            purge_all(name)
            offset = compute_tcp_offset(tool_plane, on_moving)
            ox, oy, oz = offset[0,3], offset[1,3], offset[2,3]
            print(f"{name} offset (flange frame): ({ox:.2f}, {oy:.2f}, {oz:.2f}) mm")
            print(f"{name} on_moving={on_moving}")
            tool = robot.AddTool(offset, name)
            check = tool.PoseTool()
            print(f"{name} PoseTool readback: ({check[0,3]:.2f}, {check[1,3]:.2f}, {check[2,3]:.2f}) mm")
            return tool

        if resolved_pickup is not None and robot.Valid():
            create_tool("pickup_point", resolved_pickup, fo, pickup_moving)
        elif resolved_pickup is None:
            print("WARNING: pickup_plane not connected")

        if resolved_knot is not None and robot.Valid():
            create_tool("knotting_point", resolved_knot, fo, knotting_moving)
        elif resolved_knot is None:
            print("WARNING: knotting_plane not connected")

        print("Done")

    except Exception as e:
        print(f"RoboDK error: {e}")
        import traceback
        traceback.print_exc()

    sc.sticky["last_ee_stl_path"] = static_stl_path
    a = static_stl_path
# ---------- end py3_3 ----------
move_5 = Move(Geometry=rotate_5.Geometry, Motion=vec.Vector)  # -> flatten(Geometry), Transform
filter = StreamFilter(Gate=Toggle(True), Stream0=merge_5, Stream1=merge_6)  # -> flatten(Stream)
cluster_14 = Cluster_2(
    A=Slider(480, range=0..1000),
    B=random,
    P=move.Geometry,
    A_2=Slider(173.8, range=0..200),
    t=random_2,
    D=Slider(0, range=0..90),
    panel_3=py3_2,
    R=Slider(0.412, range=0..1))  # -> flatten(R_2)
mesh_2 = MeshBrep(
    Brep=move_5.Geometry,
    Settings={GridMaxCount=0, GridMinCount=16, JaggedSeams=False, MaxEdgeLength=5000, MinEdgeLength=50, MinTolerance=0, Refine=True, RefineAngle=0, RelativeTolerance=0.65, SimplePlanes=True, Tolerance=0})  # -> flatten(Mesh)
panel_6 = Panel(py3_3.out)
merge_7 = Merge(Data1=cluster_14, Data2=filter)
panel_7 = Panel(py3_3.a)
pipe = Pipe(Curve=merge_7, Radius=yarn_radius, Caps="1", FitRail=False)  # -> flatten(Pipe)
toggle = BooleanToggle(False)
toggle_2 = BooleanToggle(False)
filter_2 = StreamFilter(Gate=toggle, Stream1=cluster_3.out_cones)
filter_3 = StreamFilter(Gate=toggle, Stream1=cluster.out_cone_centroid_bottoms)
filter_4 = StreamFilter(Gate=toggle_2, Stream1=cluster.out_cones)
filter_5 = StreamFilter(Gate=toggle_2, Stream1=cluster_3.out_cone_centroid_bottoms)
merge_8 = Merge(Data1=cluster_2.out_cones, Data2=filter_4, Data3=filter_2)  # -> flatten(Result)
addition_5 = Addition(A=cluster_4, B=Slider(402.308, range=0..1000))
mesh_3 = MeshBrep(
    Brep=pipe,
    Settings={GridMaxCount=0, GridMinCount=16, JaggedSeams=False, MaxEdgeLength=5000, MinEdgeLength=50, MinTolerance=0, Refine=True, RefineAngle=0, RelativeTolerance=0.65, SimplePlanes=True, Tolerance=0})  # -> flatten(Mesh)
flatten = FlattenTree(Tree=merge_8, Path="{0}")
merge_9 = Merge(Data1=cluster_2.out_cone_centroid_bottoms, Data2=filter_5, Data3=filter_3)
vec_9 = VectorXYZ(XComponent="0", YComponent="0", ZComponent=cluster_4)  # -> Vector, Length
move_6 = Move(Geometry=rotate.Geometry, Motion=vec_9.Vector)  # -> flatten(Geometry), Transform
rotate_6 = Rotate(Geometry=move_6.Geometry, Angle=multiplication, Plane=pl_4)  # -> Geometry, Transform
move_7 = Move(Geometry=rotate_6.Geometry, Motion=vec.Vector)  # -> flatten(Geometry), Transform
move_8 = Move(Geometry=move_7.Geometry, Motion=vec_2.Vector)  # -> flatten(Geometry), Transform
vec_10 = VectorXYZ(XComponent="0", YComponent="0", ZComponent=addition_5)  # -> Vector, Length
mesh_4 = MeshBrep(
    Brep=flatten,
    Settings={GridMaxCount=0, GridMinCount=16, JaggedSeams=False, MaxEdgeLength=5000, MinEdgeLength=50, MinTolerance=0, Refine=True, RefineAngle=0, RelativeTolerance=0.65, SimplePlanes=True, Tolerance=0})  # -> flatten(Mesh)
move_9 = Move(Geometry=merge_9, Motion=vec_9.Vector)  # -> flatten(Geometry), Transform
move_10 = Move(Geometry=merge_9, Motion=vec_10.Vector)  # -> flatten(Geometry), Transform
panel_8 = Panel(mesh_4)
panel_9 = Panel(move_9.Geometry)
swatch = ColourSwatch(SwatchColor=RGB(204, 35, 35))
py3_4 = Python3Script(trigger=Button(), cones=mesh_2, grab_points=move_7.Geometry, string_grab_points=move_7.Geometry, cone_color=swatch)  # -> out, a; inputs cones: list, grab_points: list, string_grab_points: list
# ---------- py3_4: Python ----------
from Grasshopper import DataTree
import Rhino
import Rhino.Geometry as rg
import scriptcontext as sc
import System
import struct
import os
import sys

# ---------------------------------------------------------------------------
# Script 3 — Base-relative cones (plane inputs for grab orientations)
# GH inputs:
#   cones              : geometry (DataTree one branch per cone, or flat list)
#   grab_points        : flat list of Planes, one per cone
#   string_grab_points : flat list of Planes, one per cone
#   base_origin        : Point in Rhino model space = robot base origin in RoboDK
#   cone_color         : Colour (optional, default orange)
#   string_color       : Colour (optional, default yellow)
#   trigger            : Boolean
# ---------------------------------------------------------------------------

if trigger:
    sc.sticky["last_bc_stl_path"] = ""
    print("Trigger activated, forcing re-run")

# ---------------------------------------------------------------------------
# Helpers
# ---------------------------------------------------------------------------
def flatten_input(gh_input, exclude_type=None):
    result = []
    if hasattr(gh_input, 'Branches'):
        for branch in gh_input.Branches:
            for item in branch:
                if item is not None:
                    result.append(item)
    elif hasattr(gh_input, '__iter__') and (exclude_type is None or not isinstance(gh_input, exclude_type)):
        for item in gh_input:
            if item is not None:
                result.append(item)
    elif gh_input is not None:
        result.append(gh_input)
    return result

def resolve_first_point(gh_input):
    """Resolve a GH input to the first valid rg.Point3d."""
    def to_pt(item):
        if isinstance(item, System.Guid):
            rhino_obj = sc.doc.Objects.FindId(item)
            if rhino_obj:
                geo = rhino_obj.Geometry
                if isinstance(geo, rg.Point): return geo.Location
                elif hasattr(geo, 'Location'): return geo.Location
                else: return geo.GetBoundingBox(True).Center
            return None
        if isinstance(item, rg.Point3d): return item
        if isinstance(item, rg.Point): return item.Location
        if hasattr(item, 'X') and hasattr(item, 'Y') and hasattr(item, 'Z'):
            return rg.Point3d(item.X, item.Y, item.Z)
        return None
    items = flatten_input(gh_input, exclude_type=rg.Point3d)
    if not items:
        return to_pt(gh_input)
    for item in items:
        pt = to_pt(item)
        if pt is not None:
            return pt
    return None

def resolve_plane(item):
    """
    Resolve a single input to rg.Plane.
    Accepts: rg.Plane, Guid pointing to plane/point, rg.Point3d (fallback = world-XY at that pos).
    The plane Z axis becomes the tool approach direction in RoboDK.
    """
    if item is None:
        return None
    if isinstance(item, rg.Plane):
        return item
    if isinstance(item, System.Guid):
        rhino_obj = sc.doc.Objects.FindId(item)
        if rhino_obj:
            geo = rhino_obj.Geometry
            if isinstance(geo, rg.Plane):
                return geo
            if isinstance(geo, rg.Point):
                item = geo.Location
            elif hasattr(geo, 'Location'):
                item = geo.Location
            else:
                item = geo.GetBoundingBox(True).Center
        else:
            print(f"  Could not find Guid: {item}")
            return None
    if isinstance(item, rg.Point3d):
        return rg.Plane(item, rg.Vector3d.XAxis, rg.Vector3d.YAxis)
    if isinstance(item, rg.Point):
        return rg.Plane(item.Location, rg.Vector3d.XAxis, rg.Vector3d.YAxis)
    if hasattr(item, 'X') and hasattr(item, 'Y') and hasattr(item, 'Z'):
        return rg.Plane(rg.Point3d(item.X, item.Y, item.Z), rg.Vector3d.XAxis, rg.Vector3d.YAxis)
    print(f"  Unknown plane type: {type(item)}")
    return None

def resolve_color(gh_color, default_rgba):
    if gh_color is None:
        return default_rgba
    def color_from_raw(raw):
        if raw is None: return None
        if type(raw).__name__ == 'Color' or (hasattr(raw,'R') and hasattr(raw,'G') and hasattr(raw,'B') and hasattr(raw,'A')):
            return [raw.R/255.0, raw.G/255.0, raw.B/255.0, raw.A/255.0]
        if isinstance(raw,(list,tuple)) and all(isinstance(v,(int,float)) for v in raw):
            vals = list(raw)[:4]
            if any(v>1.0 for v in vals): vals = [v/255.0 for v in vals]
            while len(vals)<4: vals.append(1.0)
            return vals
        return None
    if hasattr(gh_color,'Branches'):
        try: return color_from_raw(list(gh_color.Branches[0])[0]) or default_rgba
        except: return default_rgba
    result = color_from_raw(gh_color)
    if result: return result
    if hasattr(gh_color,'__iter__') and not isinstance(gh_color,str):
        try:
            for item in gh_color:
                if item is not None:
                    result = color_from_raw(item)
                    if result: return result
                    break
        except: pass
    return default_rgba

def diagnose_tree(name, gh_input):
    if hasattr(gh_input, 'Branches'):
        paths = list(gh_input.Paths)
        print(f"  {name}: DataTree {len(gh_input.Branches)} branches")
        for j, (path, branch) in enumerate(zip(paths, gh_input.Branches)):
            print(f"    branch[{j}] path={path} items={len(branch)} types={list(set(type(x).__name__ for x in branch))}")
    elif hasattr(gh_input, '__iter__') and not isinstance(gh_input, (rg.Mesh, rg.Point3d, rg.Plane)):
        items = list(gh_input)
        print(f"  {name}: iterable len={len(items)} types={list(set(type(x).__name__ for x in items))}")
    else:
        print(f"  {name}: single {type(gh_input).__name__}")

# ---------------------------------------------------------------------------
# Diagnostics
# ---------------------------------------------------------------------------
print("=== INPUT DIAGNOSTICS ===")
diagnose_tree("cones", cones)
diagnose_tree("grab_points", grab_points)
diagnose_tree("string_grab_points", string_grab_points)
print("=========================")

# ---------------------------------------------------------------------------
# Collect inputs
# ---------------------------------------------------------------------------
cone_branches = []
if hasattr(cones, 'Branches') and len(cones.Branches) > 1:
    for branch in cones.Branches:
        items = [item for item in branch if item is not None]
        if items:
            cone_branches.append(items)
    print(f"MODE A: {len(cone_branches)} cone branches from DataTree")
else:
    flat = flatten_input(cones)
    for item in flat:
        cone_branches.append([item])
    print(f"MODE B: {len(cone_branches)} cones from flat list")

cone_grab_planes = [resolve_plane(p) for p in flatten_input(grab_points)]
str_grab_planes  = [resolve_plane(p) for p in flatten_input(string_grab_points)]
base_orig        = resolve_first_point(base_origin) if 'base_origin' in dir() else None
cone_rgba        = resolve_color(cone_color   if 'cone_color'   in dir() else None, [1.0, 0.5, 0.0, 1.0])
string_rgba      = resolve_color(string_color if 'string_color' in dir() else None, [1.0, 1.0, 0.0, 1.0])

num_cones = len(cone_branches)
print(f"num_cones={num_cones}  cone_grabs={len(cone_grab_planes)}  str_grabs={len(str_grab_planes)}")
print(f"base_origin:  {base_orig}")
print(f"cone_color:   {[round(v,3) for v in cone_rgba]}")
print(f"string_color: {[round(v,3) for v in string_rgba]}")
for i, pl in enumerate(cone_grab_planes):
    if pl: print(f"  cone_grab_{i}: pos=({pl.Origin.X:.1f},{pl.Origin.Y:.1f},{pl.Origin.Z:.1f}) Z=({pl.ZAxis.X:.2f},{pl.ZAxis.Y:.2f},{pl.ZAxis.Z:.2f})")
for i, pl in enumerate(str_grab_planes):
    if pl: print(f"  str_grab_{i}:  pos=({pl.Origin.X:.1f},{pl.Origin.Y:.1f},{pl.Origin.Z:.1f}) Z=({pl.ZAxis.X:.2f},{pl.ZAxis.Y:.2f},{pl.ZAxis.Z:.2f})")
if base_orig is None:
    print("WARNING: base_origin not connected")

# ---------------------------------------------------------------------------
# Gate: trigger only
# ---------------------------------------------------------------------------
if not trigger and sc.sticky.get("last_bc_stl_path", "") != "":
    a = sc.sticky.get("last_bc_stl_path", "")
    print("Trigger not set — skipping.")
else:
    print("Rebuilding...")

    # -----------------------------------------------------------------------
    # STL export
    # -----------------------------------------------------------------------
    def build_and_write_stl(geo_list, stl_path):
        mesh_list = rg.Mesh()
        for geo in geo_list:
            if isinstance(geo, rg.Mesh):
                geo.Faces.ConvertQuadsToTriangles()
                mesh_list.Append(geo)
            elif isinstance(geo, rg.Brep):
                meshes = rg.Mesh.CreateFromBrep(geo, rg.MeshingParameters.Coarse)
                if meshes:
                    for m in meshes:
                        m.Faces.ConvertQuadsToTriangles()
                        mesh_list.Append(m)
            elif isinstance(geo, System.Guid):
                rhino_obj = sc.doc.Objects.FindId(geo)
                if rhino_obj:
                    obj_geo = rhino_obj.Geometry
                    if isinstance(obj_geo, rg.Mesh):
                        obj_geo.Faces.ConvertQuadsToTriangles()
                        mesh_list.Append(obj_geo)
                    elif isinstance(obj_geo, rg.Brep):
                        meshes = rg.Mesh.CreateFromBrep(obj_geo, rg.MeshingParameters.Coarse)
                        if meshes:
                            for m in meshes:
                                m.Faces.ConvertQuadsToTriangles()
                                mesh_list.Append(m)
        mesh_list.Faces.ConvertQuadsToTriangles()
        triangles = []
        for i in range(mesh_list.Faces.Count):
            face = mesh_list.Faces[i]
            triangles.append((mesh_list.Vertices[face.A], mesh_list.Vertices[face.B], mesh_list.Vertices[face.C]))
        os.makedirs(os.path.dirname(stl_path), exist_ok=True)
        with open(stl_path, 'wb') as f:
            f.write(b'\0' * 80)
            f.write(struct.pack('<I', len(triangles)))
            for v0, v1, v2 in triangles:
                f.write(struct.pack('<fff', 0, 0, 0))
                f.write(struct.pack('<fff', v0.X, v0.Y, v0.Z))
                f.write(struct.pack('<fff', v1.X, v1.Y, v1.Z))
                f.write(struct.pack('<fff', v2.X, v2.Y, v2.Z))
                f.write(struct.pack('<H', 0))
        return len(triangles)

    os.makedirs("C:/temp/base_cones", exist_ok=True)
    cone_stl_paths = []
    for i, branch_geos in enumerate(cone_branches):
        path = f"C:/temp/base_cones/base_cone_{i}.stl"
        tris = build_and_write_stl(branch_geos, path)
        cone_stl_paths.append(path)
        print(f"  base_cone_{i}: {tris} triangles -> {path}")

    # -----------------------------------------------------------------------
    # RoboDK
    # -----------------------------------------------------------------------
    try:
        sys.path.append("C:/RoboDK/Python")
        from robodk.robolink import Robolink
        from robodk.robomath import Mat

        def identity():
            return Mat([[1,0,0,0],[0,1,0,0],[0,0,1,0],[0,0,0,1]])

        def plane_to_pose(pl):
            """
            Convert a Rhino Plane to a RoboDK 4x4 pose matrix.
            Plane Z axis = tool approach direction in RoboDK.
            """
            x, y, z, o = pl.XAxis, pl.YAxis, pl.ZAxis, pl.Origin
            return Mat([
                [x.X, y.X, z.X, o.X],
                [x.Y, y.Y, z.Y, o.Y],
                [x.Z, y.Z, z.Z, o.Z],
                [0,   0,   0,   1  ]
            ])

        RDK = Robolink()
        station = RDK.Item("", 1)
        print(f"Station: {station.Name()}")

        def purge_all(name):
            count = 0
            for _ in range(50):
                item = RDK.Item(name)
                if not item.Valid(): break
                item.Delete()
                count += 1
            if count: print(f"  purged {count}x '{name}'")

        def add_file_and_get_item(stl_path):
            before = set(it.item for it in RDK.ItemList(6, False))
            RDK.AddFile(stl_path)
            for it in RDK.ItemList(6, False):
                if it.item not in before:
                    print(f"    -> loaded '{it.Name()}' id={it.item}")
                    return it
            stem = os.path.splitext(os.path.basename(stl_path))[0]
            fb = RDK.Item(stem)
            print(f"    -> fallback '{stem}' valid={fb.Valid()}")
            return fb

        # Find robot base frame
        robot_base = RDK.Item("Fanuc R2000iC 125LBase")
        if not robot_base.Valid():
            robot = RDK.Item("Fanuc R2000iC 125L")
            if not robot.Valid():
                robot = RDK.Item("", 4)
            robot_base = robot if robot.Valid() else station
        print(f"Robot base: '{robot_base.Name()}' valid={robot_base.Valid()}")

        # Purge old items — STLs first, then targets, then frames
        for i in range(100):
            if not RDK.Item(f"base_cone_{i}").Valid(): break
            purge_all(f"base_cone_{i}")
        for i in range(100):
            if not RDK.Item(f"base_cone_grab_{i}").Valid() and not RDK.Item(f"base_str_grab_{i}").Valid(): break
            purge_all(f"base_cone_grab_{i}")
            purge_all(f"base_str_grab_{i}")
        for i in range(100):
            if not RDK.Item(f"BaseCone_{i}").Valid(): break
            purge_all(f"BaseCone_{i}")
        purge_all("BaseCones")

        # Rebuild
        base_cones_frame = RDK.AddFrame("BaseCones", robot_base)
        base_cones_frame.setPose(identity())
        print("Created BaseCones frame")

        for i in range(num_cones):
            cone_frame = RDK.AddFrame(f"BaseCone_{i}", base_cones_frame)
            cone_frame.setPose(identity())

            # STL — setPoseAbs(identity) prevents robot base height from stacking
            cone_obj = add_file_and_get_item(cone_stl_paths[i])
            if cone_obj.Valid():
                cone_obj.setColor(cone_rgba)
                cone_obj.setParent(cone_frame)
                cone_obj.setPoseAbs(identity())
                print(f"  BaseCone_{i}: STL ok")
            else:
                print(f"  WARNING: BaseCone_{i} STL not valid")

            # Grab targets — setPoseAbs with full plane pose (position + orientation)
            # setPoseAbs bypasses the parent chain so robot base offset doesn't stack
            if i < len(cone_grab_planes) and cone_grab_planes[i] is not None:
                pl = cone_grab_planes[i]
                t = RDK.AddTarget(f"base_cone_grab_{i}", cone_frame)
                t.setAsCartesianTarget()
                t.setPoseAbs(plane_to_pose(pl))
                print(f"  BaseCone_{i}: cone_grab pos=({pl.Origin.X:.1f},{pl.Origin.Y:.1f},{pl.Origin.Z:.1f}) Z=({pl.ZAxis.X:.2f},{pl.ZAxis.Y:.2f},{pl.ZAxis.Z:.2f})")
            else:
                print(f"  WARNING: BaseCone_{i} missing cone_grab plane")

            if i < len(str_grab_planes) and str_grab_planes[i] is not None:
                pl = str_grab_planes[i]
                t = RDK.AddTarget(f"base_str_grab_{i}", cone_frame)
                t.setAsCartesianTarget()
                t.setPoseAbs(plane_to_pose(pl))
                print(f"  BaseCone_{i}: str_grab  pos=({pl.Origin.X:.1f},{pl.Origin.Y:.1f},{pl.Origin.Z:.1f}) Z=({pl.ZAxis.X:.2f},{pl.ZAxis.Y:.2f},{pl.ZAxis.Z:.2f})")
            else:
                print(f"  WARNING: BaseCone_{i} missing str_grab plane")

        print(f"Done -- {num_cones} base cones")

    except Exception as e:
        print(f"RoboDK error: {e}")
        import traceback
        traceback.print_exc()

    sc.sticky["last_bc_stl_path"] = cone_stl_paths[0] if cone_stl_paths else ""
    a = sc.sticky.get("last_bc_stl_path", "")
# ---------- end py3_4 ----------
py3_5 = Python3Script(
    cones=flatten(mesh_4),
    grab_points=flatten(move_9.Geometry),
    trigger=flatten(Button()),
    strings=flatten(mesh_3),
    string_grab_points=flatten(move_10.Geometry),
    cone_color=swatch,
    string_color=swatch)  # -> out, a; inputs cones: list, grab_points: list, trigger: list, strings: list, string_grab_points: list
# ---------- py3_5: Python ----------
from Grasshopper import DataTree
import Rhino
import Rhino.Geometry as rg
import scriptcontext as sc
import System
import struct
import os
import sys

if trigger:
    sc.sticky["last_stl_path"] = ""
    print("Trigger activated, forcing re-run")

def flatten_input(gh_input, exclude_type=None):
    result = []
    if hasattr(gh_input, 'Branches'):
        for branch in gh_input.Branches:
            for item in branch:
                if item is not None:
                    result.append(item)
    elif hasattr(gh_input, '__iter__') and (exclude_type is None or not isinstance(gh_input, exclude_type)):
        for item in gh_input:
            if item is not None:
                result.append(item)
    elif gh_input is not None:
        result.append(gh_input)
    return result

def diagnose_tree(name, gh_input):
    if hasattr(gh_input, 'Branches'):
        paths = list(gh_input.Paths)
        print(f"  {name}: DataTree {len(gh_input.Branches)} branches")
        for j, (path, branch) in enumerate(zip(paths, gh_input.Branches)):
            print(f"    branch[{j}] path={path} items={len(branch)} types={list(set(type(x).__name__ for x in branch))}")
    elif hasattr(gh_input, '__iter__') and not isinstance(gh_input, (rg.Mesh, rg.Point3d, rg.Plane)):
        items = list(gh_input)
        print(f"  {name}: iterable len={len(items)} types={list(set(type(x).__name__ for x in items))}")
    else:
        print(f"  {name}: single {type(gh_input).__name__}")

def resolve_plane(item):
    if item is None:
        return None
    if isinstance(item, rg.Plane):
        return item
    if isinstance(item, System.Guid):
        rhino_obj = sc.doc.Objects.FindId(item)
        if rhino_obj:
            geo = rhino_obj.Geometry
            if isinstance(geo, rg.Plane):
                return geo
            if isinstance(geo, rg.Point):
                item = geo.Location
            elif hasattr(geo, 'Location'):
                item = geo.Location
            else:
                item = geo.GetBoundingBox(True).Center
        else:
            print(f"  Could not find Guid: {item}")
            return None
    if isinstance(item, rg.Point3d):
        return rg.Plane(item, rg.Vector3d.XAxis, rg.Vector3d.YAxis)
    if isinstance(item, rg.Point):
        return rg.Plane(item.Location, rg.Vector3d.XAxis, rg.Vector3d.YAxis)
    if hasattr(item, 'X') and hasattr(item, 'Y') and hasattr(item, 'Z'):
        pt = rg.Point3d(item.X, item.Y, item.Z)
        return rg.Plane(pt, rg.Vector3d.XAxis, rg.Vector3d.YAxis)
    print(f"  Unknown plane/point type: {type(item)}")
    return None

def resolve_color(gh_color, default_rgba):
    if gh_color is None:
        return default_rgba
    def color_from_raw(raw):
        if raw is None:
            return None
        type_name = type(raw).__name__
        if type_name == 'Color' or (hasattr(raw, 'R') and hasattr(raw, 'G') and hasattr(raw, 'B') and hasattr(raw, 'A')):
            return [raw.R / 255.0, raw.G / 255.0, raw.B / 255.0, raw.A / 255.0]
        if isinstance(raw, (list, tuple)) and all(isinstance(v, (int, float)) for v in raw):
            vals = list(raw)[:4]
            if any(v > 1.0 for v in vals):
                vals = [v / 255.0 for v in vals]
            while len(vals) < 4:
                vals.append(1.0)
            return vals
        return None
    if hasattr(gh_color, 'Branches'):
        try:
            return color_from_raw(list(gh_color.Branches[0])[0]) or default_rgba
        except Exception:
            return default_rgba
    result = color_from_raw(gh_color)
    if result:
        return result
    if hasattr(gh_color, '__iter__') and not isinstance(gh_color, str):
        try:
            for item in gh_color:
                if item is not None:
                    result = color_from_raw(item)
                    if result:
                        return result
                    break
        except Exception:
            pass
    return default_rgba

print("=== INPUT DIAGNOSTICS ===")
diagnose_tree("cones", cones)
diagnose_tree("grab_points", grab_points)
diagnose_tree("string_grab_points", string_grab_points)
diagnose_tree("strings", strings)
print("=========================")

cone_rgba   = resolve_color(cone_color,   [1.0, 0.0, 0.0, 1.0])
string_rgba = resolve_color(string_color, [0.0, 1.0, 0.0, 1.0])
print(f"cone_color:   {[round(v,3) for v in cone_rgba]}")
print(f"string_color: {[round(v,3) for v in string_rgba]}")

cone_branches = []
if hasattr(cones, 'Branches') and len(cones.Branches) > 1:
    for branch in cones.Branches:
        items = [item for item in branch if item is not None]
        if items:
            cone_branches.append(items)
    print(f"MODE A: {len(cone_branches)} branches from DataTree")
else:
    flat = flatten_input(cones, exclude_type=rg.Mesh)
    for item in flat:
        cone_branches.append([item])
    print(f"MODE B: {len(cone_branches)} cones from flat list")

strings_list     = flatten_input(strings, exclude_type=rg.Mesh)
cone_grab_planes = [resolve_plane(p) for p in flatten_input(grab_points)]
str_grab_planes  = [resolve_plane(p) for p in flatten_input(string_grab_points)]

num_cones = len(cone_branches)
print(f"num_cones={num_cones}  cone_grabs={len(cone_grab_planes)}  str_grabs={len(str_grab_planes)}  strings={len(strings_list)}")
for i, pl in enumerate(cone_grab_planes):
    if pl: print(f"  cone_grab_{i}: pos=({pl.Origin.X:.1f},{pl.Origin.Y:.1f},{pl.Origin.Z:.1f})  Z=({pl.ZAxis.X:.2f},{pl.ZAxis.Y:.2f},{pl.ZAxis.Z:.2f})")
for i, pl in enumerate(str_grab_planes):
    if pl: print(f"  str_grab_{i}:  pos=({pl.Origin.X:.1f},{pl.Origin.Y:.1f},{pl.Origin.Z:.1f})  Z=({pl.ZAxis.X:.2f},{pl.ZAxis.Y:.2f},{pl.ZAxis.Z:.2f})")

if not trigger and sc.sticky.get("last_stl_path", "") != "":
    a = sc.sticky.get("last_stl_path", "")
    print("Trigger not set — skipping.")
else:
    print("Rebuilding...")

    def build_and_write_stl(geo_list, stl_path):
        mesh_list = rg.Mesh()
        for geo in geo_list:
            if isinstance(geo, rg.Mesh):
                geo.Faces.ConvertQuadsToTriangles()
                mesh_list.Append(geo)
            elif isinstance(geo, rg.Brep):
                meshes = rg.Mesh.CreateFromBrep(geo, rg.MeshingParameters.Coarse)
                if meshes:
                    for m in meshes:
                        m.Faces.ConvertQuadsToTriangles()
                        mesh_list.Append(m)
            elif isinstance(geo, System.Guid):
                rhino_obj = sc.doc.Objects.FindId(geo)
                if rhino_obj:
                    obj_geo = rhino_obj.Geometry
                    if isinstance(obj_geo, rg.Mesh):
                        obj_geo.Faces.ConvertQuadsToTriangles()
                        mesh_list.Append(obj_geo)
                    elif isinstance(obj_geo, rg.Brep):
                        meshes = rg.Mesh.CreateFromBrep(obj_geo, rg.MeshingParameters.Coarse)
                        if meshes:
                            for m in meshes:
                                m.Faces.ConvertQuadsToTriangles()
                                mesh_list.Append(m)
        mesh_list.Faces.ConvertQuadsToTriangles()
        triangles = []
        for i in range(mesh_list.Faces.Count):
            face = mesh_list.Faces[i]
            triangles.append((mesh_list.Vertices[face.A], mesh_list.Vertices[face.B], mesh_list.Vertices[face.C]))
        os.makedirs(os.path.dirname(stl_path), exist_ok=True)
        with open(stl_path, 'wb') as f:
            f.write(b'\0' * 80)
            f.write(struct.pack('<I', len(triangles)))
            for v0, v1, v2 in triangles:
                f.write(struct.pack('<fff', 0, 0, 0))
                f.write(struct.pack('<fff', v0.X, v0.Y, v0.Z))
                f.write(struct.pack('<fff', v1.X, v1.Y, v1.Z))
                f.write(struct.pack('<fff', v2.X, v2.Y, v2.Z))
                f.write(struct.pack('<H', 0))
        return len(triangles)

    os.makedirs("C:/temp/cones", exist_ok=True)
    cone_stl_paths = []
    for i, branch_geos in enumerate(cone_branches):
        path = f"C:/temp/cones/cone_{i}.stl"
        tris = build_and_write_stl(branch_geos, path)
        cone_stl_paths.append(path)
        print(f"  cone_{i}: {tris} triangles -> {path}")

    strings_stl_path = "C:/temp/strings.stl"
    string_tris = build_and_write_stl(strings_list, strings_stl_path)
    print(f"Strings: {string_tris} triangles -> {strings_stl_path}")

    try:
        sys.path.append("C:/RoboDK/Python")
        from robodk.robolink import Robolink
        from robodk.robomath import Mat

        def identity():
            return Mat([[1,0,0,0],[0,1,0,0],[0,0,1,0],[0,0,0,1]])

        def plane_to_pose(pl):
            x, y, z, o = pl.XAxis, pl.YAxis, pl.ZAxis, pl.Origin
            return Mat([
                [x.X, y.X, z.X, o.X],
                [x.Y, y.Y, z.Y, o.Y],
                [x.Z, y.Z, z.Z, o.Z],
                [0,   0,   0,   1  ]
            ])

        RDK = Robolink()
        station = RDK.Item("", 1)
        print(f"Station: {station.Name()}")

        robot = RDK.Item("Fanuc R2000iC 125L")
        if not robot.Valid(): robot = RDK.Item("", 4)
        if not robot.Valid(): robot = RDK.Item("", 2)
        print(f"Robot: {robot.Name()}")

        world_frame = RDK.Item("WorldFrame")
        if not world_frame.Valid():
            world_frame = RDK.AddFrame("WorldFrame", station)
            world_frame.setPose(identity())
            print("Created WorldFrame")
        else:
            print("Using existing WorldFrame")

        def purge_all(name):
            count = 0
            for _ in range(50):
                item = RDK.Item(name)
                if not item.Valid():
                    break
                item.Delete()
                count += 1
            if count:
                print(f"  purged {count}x '{name}'")

        def add_file_and_get_item(stl_path):
            # type 5 = object/STL
            before = set(it.item for it in RDK.ItemList(5, False))
            RDK.AddFile(stl_path)
            for it in RDK.ItemList(5, False):
                if it.item not in before:
                    print(f"    -> loaded '{it.Name()}' id={it.item}")
                    return it
            stem = os.path.splitext(os.path.basename(stl_path))[0]
            fb = RDK.Item(stem)
            print(f"    -> fallback name '{stem}' valid={fb.Valid()}")
            return fb

        def make_target(name, pl, parent_frame):
            wf = RDK.Item("WorldFrame")
            rf = RDK.Item("Fanuc R2000iC 125L")
            t = RDK.AddTarget(name, wf, rf)
            t.setAsCartesianTarget()
            t.setPoseAbs(plane_to_pose(pl))
            t.setParent(parent_frame)
            # Re-fetch by name and reapply robot link
            t2 = RDK.Item(name)
            t2.setRobot(RDK.Item("Fanuc R2000iC 125L"))
            # Verify robot link via getLink
            try:
                linked = t2.getLink(2)
                robot_name = linked.Name() if linked.Valid() else "NONE"
            except:
                robot_name = "ERROR"
            print(f"    {name}: parent='{t2.Parent().Name()}' robot='{robot_name}' valid={t2.Valid()}")

        # Purge all old items
        purge_all("strings")
        for i in range(200):
            purge_all(f"cone_grab_{i}")
            purge_all(f"string_grab_{i}")
        for i in range(200):
            purge_all(f"Cone_{i}")
        for i in range(200):
            purge_all(f"cone_{i}")
        purge_all("Cones")

        # Rebuild
        cones_frame = RDK.AddFrame("Cones", station)
        cones_frame.setPose(identity())
        print("Created Cones frame")

        strings_item = add_file_and_get_item(strings_stl_path)
        if strings_item.Valid():
            strings_item.setColor(string_rgba)
            strings_item.setParent(cones_frame)
            print("Strings: ok")
        else:
            print("WARNING: strings item not valid")

        for i in range(num_cones):
            cone_frame = RDK.AddFrame(f"Cone_{i}", cones_frame)
            cone_frame.setPose(identity())

            cone_obj = add_file_and_get_item(cone_stl_paths[i])
            if cone_obj.Valid():
                cone_obj.setColor(cone_rgba)
                cone_obj.setParent(cone_frame)
                print(f"  Cone_{i}: STL ok")
            else:
                print(f"  WARNING: Cone_{i} STL not valid")

            if i < len(cone_grab_planes) and cone_grab_planes[i] is not None:
                make_target(f"cone_grab_{i}", cone_grab_planes[i], RDK.Item(f"Cone_{i}"))
            else:
                print(f"  WARNING: Cone_{i} missing cone_grab plane")

            if i < len(str_grab_planes) and str_grab_planes[i] is not None:
                make_target(f"string_grab_{i}", str_grab_planes[i], RDK.Item(f"Cone_{i}"))
            else:
                print(f"  WARNING: Cone_{i} missing string_grab plane")

        print(f"Done -- {num_cones} cones in tree")

    except Exception as e:
        print(f"RoboDK error: {e}")
        import traceback
        traceback.print_exc()

    sc.sticky["last_stl_path"] = cone_stl_paths[0] if cone_stl_paths else ""
    a = sc.sticky.get("last_stl_path", "")
# ---------- end py3_5 ----------
panel_10 = Panel(py3_5.out)
panel_11 = Panel(py3_5.a)

# ==== cluster Cluster
relay = ClusterInput()
relay_2 = ClusterInput()
relay_3 = ClusterInput()
A = ClusterInput()
B = ClusterInput()
N = ClusterInput()
C = ClusterInput()
B_2 = ClusterInput()
Y = ClusterInput()
vec2pt = Vector2Pt(PointA=A, PointB=B, Unitize=False)  # -> Vector, Length
series = Series(Start=0, Step=N, Count=C)
pt = ConstructPoint(XCoordinate=relay, YCoordinate=relay_3, ZCoordinate=0)
subtraction = Subtraction(A=relay_2, B=relay)
addition = Addition(A=relay_3, B=B_2)
rectangle = Rectangle(Plane=PlaneXY(0, 0, 0), XSize=relay_2, YSize=Y, Radius=0)  # -> Rectangle, Length
pt_2 = ConstructPoint(XCoordinate=subtraction, YCoordinate=addition, ZCoordinate=0)
Y_2 = UnitY(Factor=series)
move = Move(Geometry=rectangle.Rectangle, Motion=vec2pt.Vector)  # -> Geometry, Transform
merge = Merge(Data1=pt, Data2=pt_2)
move_2 = Move(Geometry=graft(merge), Motion=Y_2)  # -> Geometry, Transform
out_rectangle = ClusterOutput(move.Geometry)
move_3 = Move(Geometry=move_2.Geometry, Motion=vec2pt.Vector)  # -> flatten(Geometry), Transform
G = ClusterInput()
vec = VectorXYZ(XComponent="0", YComponent="0", ZComponent="1")  # -> Vector, Length
move_4 = Move(Geometry=G, Motion=move_3.Geometry)  # -> Geometry, Transform
lng = ListLength(List=flatten(move_4.Geometry))
pl = PlaneNormal(Origin=move_3.Geometry, ZAxis=vec.Vector)
L = ClusterOutput(lng)
out_cone_centroid_bottoms = ClusterOutput(pl)
out_cones = ClusterOutput(move_4.Geometry)

# ==== cluster Cluster_2
A = ClusterInput()
A_2 = ClusterInput()
B = ClusterInput()
P = ClusterInput()
t = ClusterInput()
division = Division(A=A_2, B=2)
D = ClusterInput()
multiplication = Multiplication(A=A, B=B)
cir = Circle(Plane=P, Radius=division)
rad = Radians(Degrees=D)
subtraction = Subtraction(A=A, B=multiplication)
R = ClusterInput()
Z = UnitZ(Factor=1)
Z_2 = UnitZ(Factor=subtraction)
eval = EvaluateCurve(Curve=reparameterize(cir), Parameter=t)  # -> Point, Tangent, Angle
move = Move(Geometry=P, Motion=Z_2)  # -> Geometry, Transform
vec2pt = Vector2Pt(PointA=move.Geometry, PointB=eval.Point, Unitize=False)  # -> Vector, Length
neg = Negative(Value=eval.Tangent)
filter = StreamFilter(Gate=Toggle(True), Stream0=eval.Tangent, Stream1=neg)
line = LineSDL(Start=move.Geometry, Direction=Z, Length=multiplication)
xprod = CrossProduct(VectorA=vec2pt.Vector, VectorB=Z, Unitize=False)  # -> Vector, Length
vrot = Rotate(Vector=Z, Axis=xprod.Vector, Angle=rad)
end = EndPoints(Curve=line)  # -> Start, End
biarc = BiArc(StartPoint=eval.Point, StartTangent=filter, EndPoint=move.Geometry, EndTangent=vrot, Ratio=R)  # -> FirstArc, SecondArc, flatten(BiArc)
weave = Weave(Pattern=[0, 1], Stream0=line, Stream1=biarc.BiArc, NullGaps=False)  # -> flatten(Weave)
partition = PartitionList(List=weave, Size="2")
panel = Panel(partition)
panel_2 = Panel(biarc.BiArc)
ln = Line(StartPoint=eval.Point, EndPoint=end.End)
join = JoinCurves(Curves=partition, Preserve=False)  # -> flatten(Curves)
panel_3 = ClusterInput()
panel_4 = Panel(ln)
p_n_c = PickNChoose(Pattern=panel_3, Stream0=ln, Stream1=join)
panel_5 = Panel(panel_3)
panel_6 = Panel(p_n_c)
R_2 = ClusterOutput(p_n_c)
panel_7 = Panel(join)

# ==== cluster Cluster_3
C = ClusterInput()
bbox = BoundingBox(Content=C, Plane=PlaneXY(0, 0, 0))  # -> Box, Box_2
debox = DeconstructBox(Box=bbox.Box)  # -> Plane, X, Y, Z
dedomain = DeconstructDomain(Domain=debox.Z)  # -> Start, End
subtraction = Subtraction(A=dedomain.End, B=dedomain.Start)
R = ClusterOutput(subtraction)

# ==== cluster Cluster_4
start_line_1 = ClusterInput()
B = ClusterInput()
A = ClusterInput()
B_2 = ClusterInput()
ln = Line(StartPoint=start_line_1, EndPoint=B)
ln_2 = Line(StartPoint=A, EndPoint=B_2)
N = ClusterInput()
divide = DivideCurve(Curve=ln, Count=expr("x-1", N), Kinks=False)  # -> Points, Tangents, Parameters
divide_2 = DivideCurve(Curve=ln_2, Count=expr("x-1", N), Kinks=False)  # -> Points, Tangents, Parameters
ln_3 = Line(StartPoint=divide.Points, EndPoint=divide_2.Points)
L = ClusterOutput(ln_3)

# ==== cluster Cluster_5
relay = ClusterInput()
relay_2 = ClusterInput()
B = ClusterInput()
Z = ClusterInput()
pt = ConstructPoint(XCoordinate="0", YCoordinate="0", ZCoordinate="0")
pt_2 = ConstructPoint(XCoordinate="0", YCoordinate="0", ZCoordinate=Z)
pdecon = Deconstruct(Point=pt_2)  # -> XComponent, YComponent, ZComponent
addition = Addition(A=pdecon.ZComponent, B=B)
division = Division(A=relay_2, B="-2")
division_2 = Division(A=relay, B="-2")
vec = VectorXYZ(XComponent="1", YComponent="0", ZComponent="0")  # -> Vector, Length
rectangle = Rectangle(Plane=pt, XSize=relay_2, YSize=relay, Radius=0)  # -> Rectangle, Length
pt_3 = ConstructPoint(XCoordinate=pdecon.XComponent, YCoordinate=pdecon.YComponent, ZCoordinate=addition)
vec_2 = VectorXYZ(XComponent=division, YComponent=division_2, ZComponent="0")  # -> Vector, Length
pdecon_2 = Deconstruct(Point=pt_2)  # -> XComponent, YComponent, ZComponent
division_3 = Division(A=relay_2, B="2")
division_4 = Division(A=relay, B="2")
pdecon_3 = Deconstruct(Point=pt)  # -> XComponent, YComponent, ZComponent
move = Move(Geometry=rectangle.Rectangle, Motion=vec_2.Vector)  # -> Geometry, Transform
subtraction = Subtraction(A=pdecon_2.XComponent, B=division_3)
pt_4 = ConstructPoint(XCoordinate=subtraction, YCoordinate=pdecon_2.YComponent, ZCoordinate=pdecon_2.ZComponent)
subtraction_2 = Subtraction(A=pdecon_2.ZComponent, B=pdecon_3.ZComponent)
vec_3 = VectorXYZ(XComponent="0", YComponent="0", ZComponent=subtraction_2)  # -> Vector, Length
extr = Extrude(Base=move.Geometry, Direction=vec_3.Vector)
cap = CapHoles(Brep=extr)
pdecon_4 = Deconstruct(Point=pt_3)  # -> XComponent, YComponent, ZComponent
B_2 = ClusterInput()
vec_4 = VectorXYZ(XComponent=0, YComponent=0, ZComponent=pdecon_4.ZComponent)  # -> Vector, Length
move_2 = Move(Geometry=move.Geometry, Motion=vec_4.Vector)  # -> Geometry, Transform
pl = PlaneNormal(Origin=pt_4, ZAxis=vec.Vector)
cyl = Cylinder(Base=pl, Radius=division_4, Length=relay_2)
cap_2 = CapHoles(Brep=cyl)
merge = Merge(Data1=cap, Data2=cap_2)
sunion = SolidUnion(Breps=merge)
bbox = BoundingBox(Content=sunion, Plane=PlaneXY(0, 0, 0))  # -> Box, Box_2
debox = DeconstructBox(Box=bbox.Box)  # -> Plane, X, Y, Z
num = Number(debox.Z)
subtraction_3 = Subtraction(A=pdecon_4.ZComponent, B=num)
panel = Panel(num)
subtraction_4 = Subtraction(A=subtraction_3, B=B_2)
multiplication = Multiplication(A=subtraction_4, B="-1")
vec_5 = VectorXYZ(XComponent=0, YComponent=0, ZComponent=multiplication)  # -> Vector, Length
extr_2 = Extrude(Base=move_2.Geometry, Direction=vec_5.Vector)
cap_3 = CapHoles(Brep=extr_2)
R = ClusterOutput(sunion)
B_3 = ClusterOutput(cap_3)
P = ClusterOutput(pl)
